% Simulink data dictionary BatteryManagement_data.sldd

BESSoCReset = Simulink.Parameter(false, DataType="boolean")  % Boolean to reset ES SoC
rCellCapacity = Simulink.Parameter(repmat(64, 1, 6), DataType="double", Unit="Ah")  % Initial Cell Capacity
R2_LUT = Simulink.Parameter([0.001022342; 0.001022342; 0.0009111369; 0.0009137489; 0.0009539016; 0.0009772174; 0.0008535986; 0.0008611733; 0.001108722; 0.001174027; 0.001174027], DataType="double", Unit="Ω")  % R2 Lookup Table
R1_LUT = Simulink.Parameter([0.00104727; 0.00104727; 0.000248441; 0.0002184437; 0.0004864429; 0.0004000834; 0.0004082974; 0.000354919; 0.0004467292; 0.0002831548; 0.0002831548], DataType="double", Unit="Ω")  % R1 Lookup Table
R0_LUT = Simulink.Parameter([0.001630769; 0.001630769; 0.0016; 0.0016; 0.0016; 0.001569231; 0.001569231; 0.001630769; 0.0016; 0.001798699; 0.001798699], DataType="double", Unit="Ω")  % R0 Lookup Table
OCV_LUT = Simulink.Parameter([2.8; 3.531; 3.723; 3.802; 3.869; 3.909; 3.949; 3.984; 4.048; 4.086; 4.182], DataType="double", Unit="V")  % Open-Circuit Voltage Lookup Table
C2_LUT = Simulink.Parameter([25640.9; 25640.9; 32135.76; 32135.76; 37289.34; 34003.19; 26539.67; 31883.64; 28172.99; 23205.46; 23205.46], DataType="double", Unit="F")  % C2 Lookup Table
C1_LUT = Simulink.Parameter([1295651; 1295651; 1753730; 2232989; 1322336; 1761751; 1404185; 1377061; 946091.5; 2605208; 2605208], DataType="double", Unit="F")  % C1 Lookup Table
SoC_LUT = Simulink.Parameter([0 10 20 30 40 50 60 70 80 90 100], DataType="single", Unit="%")  % State of Charge Lookup Table
rInitialSoC = Simulink.Parameter(repmat(90, 1, 6), DataType="double", Unit="%")  % Initial cell SoC

BMSInputs_BUS = Simulink.Bus()
  IESIVT: double, Unit="A"  % ES IVT Current Measurement
  VESCell: double[6], Unit="V"  % Array of Cell Voltages
  NPTState: double  % Main Powertrain State

BMSCmds_BUS = Simulink.Bus()
  IESMin: double, Unit="A"  % BMS Lower Current Limit (Peak Charge Current)
  IESMax: double, Unit="A"  % BMS Upper Current Limit (Peak Discharge Current)

tSimBattMgt = Simulink.Parameter(0.005, DataType="double", Unit="s")  % Simulation Step Time for Battery Management model