% Simulink data dictionary Contactors_data.sldd

ContactorsInputs_BUS = Simulink.Bus()
  VESIVT: double, Unit="V"  % ES IVT Voltage Measurement
  VCUKIVT: double, Unit="V"  % CUK IVT Voltage Measurement
  NPTState: double  % Main Powertrain State

ContactorsCmds_BUS = Simulink.Bus()
  BContPosRequested: boolean
  BContNegRequested: boolean
  BPrechargeRequested: boolean
  BActiveDischargeRequested: boolean

tSimCont = Simulink.Parameter(0.005, DataType="double", Unit="s")  % Simulation Step Time for Contactors model
tCloseContDelay = Simulink.Parameter(0.2, Unit="s")  % Delay before closing contactors
BServiceDisconnectPos = Simulink.Parameter(true, DataType="boolean")
BServiceDisconnectNeg = Simulink.Parameter(true, DataType="boolean")

eNPTState = enum(DefaultValue="Off", StorageType="uint8")
  Off = 0  % Powertrain is off
  ContactorsCloseRequest = 1  % Contactors are requested to close
  ContactorsClosed = 2  % Contactors are closed
  TorqueControl = 3  % Motor accepts torque requests
  ContactorsOpenRequest = 4  % Contactors are requested to open